# Grasshopper definition hops_plot_edit.gh (Grasshopper 1.0.7)
# plug-ins: Hops

# ----
# MORE INFO AT: https://www.antoinemaes.com/plot-it
# &
# https://github.com/MaesAntoine/Hops_plots
# Desired data to show
# Series of boxplots (8)
number_slider = Slider(100, range=0..100)
number_slider_2 = Slider(50, range=0..100)
number_slider_3 = Slider(20, range=0..100)
number_slider_4 = Slider(83, range=0..100)
number_slider_5 = Slider(41, range=0..100)
number_slider_6 = Slider(62, range=0..100)
number_slider_7 = Slider(36, range=0..100)
number_slider_8 = Slider(43, range=0..100)
construct_domain = ConstructDomain(DomainStart=0, DomainEnd=number_slider)
construct_domain_2 = ConstructDomain(DomainStart=0, DomainEnd=number_slider_2)
construct_domain_3 = ConstructDomain(DomainStart=0, DomainEnd=number_slider_3)
construct_domain_4 = ConstructDomain(DomainStart=0, DomainEnd=number_slider_4)
construct_domain_5 = ConstructDomain(DomainStart=0, DomainEnd=number_slider_5)
construct_domain_6 = ConstructDomain(DomainStart=0, DomainEnd=number_slider_6)
construct_domain_7 = ConstructDomain(DomainStart=0, DomainEnd=number_slider_7)
construct_domain_8 = ConstructDomain(DomainStart=0, DomainEnd=number_slider_8)
range = Range(Domain=construct_domain, Steps=number_slider)
range_2 = Range(Domain=construct_domain_2, Steps=number_slider_2)
range_3 = Range(Domain=construct_domain_3, Steps=number_slider_3)
range_4 = Range(Domain=construct_domain_4, Steps=number_slider_4)
range_5 = Range(Domain=construct_domain_5, Steps=number_slider_5)
range_6 = Range(Domain=construct_domain_6, Steps=number_slider_6)
range_7 = Range(Domain=construct_domain_7, Steps=number_slider_7)
range_8 = Range(Domain=construct_domain_8, Steps=number_slider_8)
entwine = Entwine(
    Branch00=range,
    Branch01=range_2,
    Branch02=range_3,
    Branch03=range_4,
    Branch04=range_5,
    Branch05=range_6,
    Branch06=range_7,
    Branch07=range_8,
    FlattenInputs=True)  # -> simplify(Result)
panel = Panel(entwine)
data = Data(entwine)

# ---- group: get currently supported plots and palettes from categories
concat = Concatenate(FragmentA="http://127.0.0.1:5000/", FragmentB="presets")
hops = Hops(
    _Path=concat,
    PlotTypes="categorical",
    PaletteTypes="diverging",
    CacheResultsInMemory=False,
    CacheSolveResults=False,
    RemoteDefinitionLocation="http://127.0.0.1:5000/presets",
    RemoteSolveVersion=(0, 1, 0),
    ShowInput_Enabled=False,
    ShowInput_Path=True,
    SynchronousSolve=True)  # -> AvailablePlots, AvailablePalettes

# ---- group: build dataframe to plot
datatree_nomenclature = Panel("Component")
concat_2 = Concatenate(FragmentA="http://127.0.0.1:5000/", FragmentB="dt_to_df")
data_in_datatree = Panel("kg")
hops_2 = Hops(
    _Path=concat_2,
    DataAsTree=data,
    TreeStructureLabels=datatree_nomenclature,
    Datatype=data_in_datatree,
    CacheResultsInMemory=False,
    CacheSolveResults=False,
    RemoteDefinitionLocation="http://127.0.0.1:5000/dt_to_df",
    RemoteSolveVersion=(0, 1, 0),
    ShowInput_Enabled=False,
    ShowInput_Path=True,
    SynchronousSolve=True)

# ---- group: select the plot and the palette within their category
list = ValueList({"0", "1", "2", "3", "4", "5", "6", "7", "8"}, selected="5")
item = ListItem(List=hops.AvailablePlots, Index=list, Wrap=True)
item_2 = ListItem(List=hops.AvailablePalettes, Index=Slider(5, range=0..17), Wrap=True)
concat_3 = Concatenate(FragmentA="http://127.0.0.1:5000/", FragmentB=item)
panel_2 = Panel(item)

# ---- group: plotting
plot = Button()
panel_3 = Panel("Component")

# ----
# Component can fail either for abnormal inputs for the specified plot, or if the main thread has been caught in outside of the main loop.
# 
# If any of the two happens, you should restart the server.
# 
# No comments from devs for 300 days #hopsisdead
hops_3 = Hops(
    _Path=concat_3,
    Dataframe=hops_2,
    XAxis=panel_3,
    YAxis="kg",
    Hue=panel_3,
    Dodge=True,
    KDepth="tukey",
    Palette=item_2,
    Fliers=True,
    Plot=plot,
    CacheResultsInMemory=False,
    CacheSolveResults=False,
    RemoteDefinitionLocation="http://127.0.0.1:5000/boxenplot",
    RemoteSolveVersion=(0, 1, 0),
    ShowInput_Enabled=False,
    ShowInput_Path=True,
    SynchronousSolve=True)
